# Grasshopper definition CsvReader.gh (Grasshopper 1.0.7)
# plug-ins: Bifocals, EleFront

list = ValueList({"Point": 0, "Curve": 1, "Arc": 2, "Circle": 3, "Ellipse": 4, "Line": 5, "Polyline": 6, "Surface": 7, "Brep": 8, "Mesh": 9, "Polysurface": 10, "Block": 11, "Text": 12, "TextDot": 13, "Dimension": 14, "LinearDimension": 15, "AngularDimension": 16, "Hatch": 17, "Leader": 18}, selected="Block")
list_2 = ValueList({"Point": 0, "Curve": 1, "Arc": 2, "Circle": 3, "Ellipse": 4, "Line": 5, "Polyline": 6, "Surface": 7, "Brep": 8, "Mesh": 9, "Polysurface": 10, "Block": 11, "Text": 12, "TextDot": 13, "Dimension": 14, "LinearDimension": 15, "AngularDimension": 16, "Hatch": 17, "Leader": 18}, selected="Brep")
file_path = Panel("C:\CsvReader_data.csv")

# ----
# CLEAN DATA
# Fix data that is:
# -incorrect
# -innacurate
# -incomplete
# -irrelevant
# Define a point
pt = Point(Point(0, 0, 0))

reftype = ReferenceByType(ObjectType=list)
reftype_2 = ReferenceByType(ObjectType=list_2)
deblock = DeconstructBlock(Block=reftype, recursive=True)  # -> Name, Plane, flatten(Geometry)
path = FilePath(file_path)
# TIDY DATA
# Organize data:
# - One variable per column
# - One entry per row
# - One purpose per table
merge = Merge(Data1=flatten(reftype_2), Data2=deblock.Geometry)
file = ReadFile(File=path, PerLineParse=True)
split_char = Panel(",")
rhatt = GetRhinoAttributes(Geometry=merge)  # -> Name, Layer, Color
split = TextSplit(Text=file, Separators=split_char)
txt = Text(rhatt.Layer)
flip = FlipMatrix(Data=split)
cset = CreateSet(List=txt)  # -> Set, Map
split_index = Panel("1")
split_2 = SplitList(List=flip, Index=split_index)  # -> simplify(ListA), simplify(ListB)
cset_2 = CreateSet(List=cset.Map)  # -> Set, Map
mindex = MemberIndex(Set=cset.Map, Member=cset_2.Set)  # -> Index, Count
layer_names = Panel(cset.Set)
item = ListItem(List=merge, Index=mindex.Index, Wrap=True)  # -> simplify(Item)
path_2 = ConstructPath(Indices="6")
path_3 = ConstructPath(Indices="5")
path_4 = ConstructPath(Indices="2")
path_5 = ConstructPath(Indices="4")
path_6 = ConstructPath(Indices="3")
path_7 = ConstructPath(Indices="0")
path_8 = ConstructPath(Indices="1")
lng = ListLength(List=layer_names)
branch = TreeBranch(Tree=split_2.ListB, Path=path_2, MaintainPaths=True)  # -> flatten(Branch)
lng_2 = ListLength(List=item)
branch_2 = TreeBranch(Tree=split_2.ListB, Path=path_3, MaintainPaths=True)  # -> flatten(Branch)
panel = Panel(item)
branch_3 = TreeBranch(Tree=split_2.ListB, Path=path_4, MaintainPaths=True)  # -> flatten(Branch)
branch_4 = TreeBranch(Tree=split_2.ListB, Path=path_5, MaintainPaths=True)  # -> flatten(Branch)
branch_5 = TreeBranch(Tree=split_2.ListB, Path=path_6, MaintainPaths=True)  # -> flatten(Branch)
branch_6 = TreeBranch(Tree=split_2.ListB, Path=path_7, MaintainPaths=True)  # -> flatten(Branch)
branch_7 = TreeBranch(Tree=split_2.ListB, Path=path_8, MaintainPaths=True)  # -> flatten(Branch)
random = Random(Range="0 to 255", Number=lng, Seed=250)
random_2 = Random(Range="0 to 255", Number=lng, Seed=2)
# Normally item 0 for each list the column title
panel_2 = Panel(split_2.ListA)
random_3 = Random(Range="0 to 255", Number=lng, Seed=52)
int = Integer(random_3)
int_2 = Integer(random_2)
int_3 = Integer(random)
num = Number(branch_2)
num_2 = Number(branch_4)
num_3 = Number(branch_5)
num_4 = Number(branch_6)
num_5 = Number(branch_7)
num_6 = Number(branch_3)
volume = Volume(Geometry=item)  # -> Volume, Centroid
rgb = ColourRGB(Alpha=255, Red=int_2, Green=int, Blue=int_3)  # -> simplify(graft(Colour))
panel_3 = Panel(branch)
ma = MassAddition(Input=volume.Volume)  # -> Result, PartialResults
repeat = RepeatData(Data=rgb, Length=lng_2)
preview = CustomPreview(Geometry=item, Material=repeat)
division = Division(A=ma.Result, B="1e9")
volumes = Panel(division)
tmatch = MatchText(Text=branch, RegEx=graft(layer_names), Case=False)
cull = CullPattern(List=branch, CullPattern=tmatch)
keysearch = KeyValueSearch(Keys=branch, Values=num_5, Search=cull)
avr = Average(Input=keysearch)
multiplication = Multiplication(A=division, B=avr)
division_2 = Division(A=multiplication, B="1000")
panel_4 = Panel(cull)
int_4 = Integer(division_2)
multiplication_2 = Multiplication(A=int_4, B="1000")
panel_5 = Panel(avr)
panel_6 = Panel(keysearch)
ma_2 = MassAddition(Input=flatten(multiplication_2))  # -> Result, PartialResults
expression = Expression(x=multiplication_2, Expression="format(\"{0}\",x)")
expression_2 = Expression(x=ma_2.Result, Expression="format(\"{0}\",x)")
# GWP ----> kg CO2        eq/m3
# ODP ----> μg R11        eq/m3
# POCP ---> g Ethene      eq/m3
# AP  ----> g SO2         eq
# EP  ----> g PO4(Phosphate)   eq/m3
concat = Concatenate(FragmentE="GWP ", FragmentA=flatten(layer_names), FragmentC=": ", FragmentB=flatten(expression), FragmentD=" kg CO2")
concat_2 = Concatenate(FragmentE="Total ", FragmentA=flatten("GWP "), FragmentC=": ", FragmentB=flatten(expression_2), FragmentD=" kg CO2")  # -> graft(Result)
panel_7 = Panel(concat_2)
panel_8 = Panel(concat)
rgb_2 = ColourRGB(Alpha=255, Red=0, Green=0, Blue=0)
ins = InsertItems(List=flatten(rgb), Item=rgb_2, Indices=-1, Wrap=True)
ins_2 = InsertItems(List=panel_8, Item=panel_7, Indices=-1, Wrap=True)
lng_3 = ListLength(List=ins_2)
pdecon = Deconstruct(Point=pt)  # -> XComponent, YComponent, ZComponent
series = Series(Start=0, Step=Slider(2, range=0..10, expression="-(x*100)"), Count=lng_3)
pt_2 = ConstructPoint(XCoordinate=pdecon.XComponent, YCoordinate=series, ZCoordinate=pdecon.ZComponent)
tag = TextTag3D(Location=pt_2, Text=ins_2, Size="100", Colour=ins, Justification=7)
