# Grasshopper definition RevittoRhino.gh (Grasshopper 1.0.7)
# plug-ins: Rhino.Inside for Autodesk Revit, Bifocals, EleFront

panel = Panel("Rooms")  # disabled
swatch = ColourSwatch(SwatchColor=RGB(175, 210, 113))  # disabled
swatch_2 = ColourSwatch(SwatchColor=RGB(55, 183, 84))
swatch_3 = ColourSwatch(SwatchColor=RGB(234, 216, 84))
swatch_4 = ColourSwatch(SwatchColor=RGB(239, 95, 84))
swatch_5 = ColourSwatch(SwatchColor=RGB(154, 58, 84))
swatch_6 = ColourSwatch(SwatchColor=RGB(189, 123, 154))
swatch_7 = ColourSwatch(SwatchColor=RGB(78, 43, 154))
# Floors
# Walls
# Ceilings
# Structural Columns
# Curtain Wall Mullions
# Curtain Panels
# Roof
button = Button()
# Rooms into Rhino
categories = QueryCategories(Type=1, Name=panel, IsSubcategory=False)  # disabled
panel_2 = Panel("Generic Models")
layer = DefineLayer(Name=panel, Color=swatch)  # disabled
categories_2 = QueryCategories(Type=1, Name="Stairs", IsSubcategory=False)
catfltr = CategoryFilter(Categories=categories, Inverted=False)  # disabled
layer_2 = DefineLayer(Name="Stairs", Color=ColourSwatch(SwatchColor=RGB(103, 185, 154)))
elements = QueryElements(Filter=catfltr, Limit=100)  # -> Elements, Count; disabled
panel_3 = Panel("""Floors
Ramps
Stairs""")
catfltr_2 = CategoryFilter(Categories=categories_2, Inverted=False)
elements_2 = QueryElements(Filter=catfltr_2)  # -> simplify(Elements), Count
geometry = ElementGeometry(Elements=elements.Elements)  # -> flatten(Geometry); disabled
panel_4 = Panel(elements_2.Elements)
bbox = BoundingBox(Content=geometry, Plane=PlaneXY(0, 0, 0))  # -> Box, Box_2; disabled
panel_5 = Panel("""Id
Family Name
Type Name""")
geometry_2 = ElementGeometry(Elements=elements_2.Elements)  # -> simplify(flatten(Geometry))
volume = Volume(Geometry=bbox.Box)  # -> Volume, Centroid; disabled
debox = DeconstructBox(Box=bbox.Box)  # -> Plane, X, Y, Z; disabled
param = ElementParameter(Element=graft(elements_2.Elements), Parameter=panel_5)  # -> Element, Parameter, simplify(Value)
panel_6 = Panel("""Id
Name
Number
Area""")  # disabled
materials = ElementMaterials(Element=elements_2.Elements)  # -> Materials, Paint
dedomain = DeconstructDomain(Domain=debox.Z)  # -> Start, End; disabled
subtraction = Subtraction(A=dedomain.Start, B=dedomain.End)  # disabled
cset = CreateSet(List=panel_6)  # -> Set, Map; disabled
param_2 = ElementParameter(Element=graft(elements.Elements), Parameter=panel_6)  # -> Element, Parameter, simplify(Value); disabled
identity = MaterialIdentity(Material=materials.Materials)  # -> simplify(Name), Description, Class, Comments, Manufacturer, Model, Cost, URL, Keynote, Mark
panel_7 = Panel("2")  # disabled
sec = BrepPlane(Brep=geometry, Plane=volume.Centroid)  # -> Curves, Points; disabled
panel_8 = Panel("Area")  # disabled
division = Division(A=subtraction, B=panel_7)  # disabled
panel_9 = Panel("-1")  # disabled
mindex = MemberIndex(Set=cset.Set, Member=panel_8)  # -> Index, Count; disabled
item = ListItem(List=param.Value, Index=0, Wrap=True)  # -> flatten(Item)
Z = UnitZ(Factor=division)  # disabled
item_2 = ListItem(List=param_2.Value, Index=panel_9, Wrap=True)  # disabled
area = Area(Geometry=sec.Curves)  # -> Area, Centroid; disabled
join = TextJoin(Text=identity.Name, Join=" | ")
lng = ListLength(List=panel_6)  # disabled
item_3 = ListItem(List=param_2.Value, Index=0, Wrap=True)  # -> flatten(Item); disabled
sort = SortList(Keys=area.Area, ValuesA=sec.Curves)  # -> Keys, ValuesA; disabled
panel_10 = Panel("1000000")  # disabled
panel_11 = Panel("-1")  # disabled
ins = InsertItems(List=panel_5, Item="Material", Indices="-1", Wrap=True)
item_4 = ListItem(List=sort.ValuesA, Index=panel_11, Wrap=True)  # -> flatten(Item); disabled
division_2 = Division(A=item_2, B=panel_10)  # disabled
repeat = RepeatData(Data=mindex.Index, Length=lng)  # disabled
move = Move(Geometry=item_4, Motion=Z)  # -> Geometry, Transform; disabled
ins_2 = InsertItems(List=param.Value, Item=join, Indices="-1", Wrap=True)
brep = Brep(move.Geometry)  # disabled
attributes = DefineObjectAttributes(UserKeys=ins, UserValues=ins_2, Name=graft(item), Layer=layer_2)  # -> simplify(Attributes)
replace = ReplaceItems(List=param_2.Value, Item=division_2, Indices=repeat, Wrap=False)  # disabled
panel_12 = Panel(ins_2)
attributes_2 = DefineObjectAttributes(UserKeys=panel_6, UserValues=replace, Name=graft(item_3), Layer=layer)  # -> flatten(Attributes); disabled
bake = BakeObjects(Geometry=geometry_2, Attributes=attributes, BakeName="Stairs", Bake=button)
bake_2 = BakeObjects(Geometry=brep, Attributes=attributes_2, BakeName=panel, Bake=False)  # disabled

panel_13 = Panel("""Walls
Floors
Ceilings
Roofs
Doors
Windows""")
categories_3 = QueryCategories(Type=1, Name=panel_13, IsSubcategory=False)
catfltr_3 = CategoryFilter(Categories=categories_3, Inverted=False)
elements_3 = QueryElements(Filter=catfltr_3, Limit=100)  # -> simplify(Elements), Count
materials_2 = ElementMaterials(Element=elements_3.Elements)  # -> Materials, Paint
panel_14 = Panel("""Id
Family Name
Type Name""")
geometry_3 = ElementGeometry(Elements=elements_3.Elements)  # -> simplify(Geometry)
identity_2 = MaterialIdentity(Material=materials_2.Materials)  # -> simplify(Name), Description, Class, Comments, Manufacturer, Model, Cost, URL, Keynote, Mark
param_3 = ElementParameter(Element=graft(elements_3.Elements), Parameter=panel_14)  # -> Element, Parameter, simplify(Value)
panel_15 = Panel(geometry_3)
join_2 = TextJoin(Text=identity_2.Name, Join=" | ")
item_5 = ListItem(List=param_3.Value, Index=0, Wrap=True)  # -> flatten(Item)
ins_3 = InsertItems(List=panel_14, Item="Material", Indices="-1", Wrap=True)
ins_4 = InsertItems(List=param_3.Value, Item=join_2, Indices="-1", Wrap=True)

lng_2 = ListLength(List=panel_13)
random = Random(Range="0 to 255", Number=lng_2, Seed="2")
random_2 = Random(Range="0 to 255", Number=lng_2, Seed="3")
random_3 = Random(Range="0 to 255", Number=lng_2, Seed="1")
rgb = ColourRGB(Alpha=255, Red=random_3, Green=random, Blue=random_2)

layer_3 = DefineLayer(Name=panel_13, Color=rgb)
attributes_3 = DefineObjectAttributes(UserKeys=ins_3, UserValues=ins_4, Name=item_5, Layer=layer_3)  # -> simplify(Attributes)
bake_3 = BakeObjects(Geometry=geometry_3, Attributes=attributes_3, BakeName=panel_13, Bake=False)
