# Grasshopper definition WIP_MassGenerator.gh (Grasshopper 1.0.7)
# plug-ins: Bifocals

# ----
# Output
seed_selector = Slider(61, range=0..500)
text_size = Panel("1000")
pt = Point(Point(666.0244538, -9574.383552, 0))

# ----
# Location input
offset_from_boundary = Panel("5000")
target = Panel("30 to 70")
crv = Curve(<curve referenced from the Rhino model>)

# ----
# Massing input
footprint_size_range_in_mm = Panel("10000 to 25000")
target_gfa_in_m2 = Panel("9000")
floor_height_mm = Panel("3500")

genes = GenePool(Decimals=1, Maximum=100, Minimum=0, Value=[25.91972436, 46.5787634, 45.82999174])
genes_2 = GenePool(Decimals=1, Maximum=100, Minimum=0, Value=[62.12259599, 33.78612489, 97.6314201])

remap = RemapNumbers(Value=genes, Source="0 to 100", Target=target)  # -> Mapped, Clipped
remap_2 = RemapNumbers(Value=genes_2, Source="0 to 100", Target=target)  # -> Mapped, Clipped
division = Division(A=remap.Mapped, B="100")
division_2 = Division(A=remap_2.Mapped, B="100")
offset = OffsetCurve(Curve=crv, Distance=expr("-x", offset_from_boundary), Corners=1)
pt_2 = ConstructPoint(XCoordinate=division, YCoordinate=division_2, ZCoordinate=0)
srf = Surface(reparameterize(offset))

genes_3 = GenePool(Decimals=1, Maximum=100, Minimum=0, Value=[71.46788941, 19.01942776, 86.1461264])
genes_4 = GenePool(Decimals=0, Maximum=25, Minimum=1, Value=[8.382370073, 5.675198419, 1.184535399])
genes_5 = GenePool(Decimals=1, Maximum=100, Minimum=0, Value=[88.48248436, 41.96820592, 62.65948138])

evalsrf = EvaluateSurface(Surface=srf, Point=pt_2)  # -> Point, Normal, UDirection, VDirection, Frame
preview = CustomPreview(Geometry=srf, Material=ColourSwatch(SwatchColor=RGB(207, 109, 109)))
pt_3 = Point(evalsrf.Point)
remap_3 = RemapNumbers(Value=genes_5, Source="0 to 100", Target=footprint_size_range_in_mm)  # -> Mapped, Clipped
remap_4 = RemapNumbers(Value=genes_3, Source="0 to 100", Target=footprint_size_range_in_mm)  # -> Mapped, Clipped
multiplication = Multiplication(A=genes_4, B=floor_height_mm)
dom = ConstructDomain(DomainStart=expr("-x/2", remap_4.Mapped), DomainEnd=expr("x/2", remap_4.Mapped))
dom_2 = ConstructDomain(DomainStart=expr("-x/2", remap_3.Mapped), DomainEnd=expr("x/2", remap_3.Mapped))
Z = UnitZ(Factor=multiplication)
rectangle = Rectangle(Plane=pt_3, XSize=dom, YSize=dom_2, Radius=0)  # -> Rectangle, Length
srf_2 = Surface(rectangle.Rectangle)
extr = Extrude(Base=srf_2, Direction=Z)
sunion = SolidUnion(Breps=extr)
preview_2 = CustomPreview(Geometry=extr, Material=ColourSwatch(SwatchColor=RGB(128, 209, 205)))
pt_4 = ConstructPoint(XCoordinate="0", YCoordinate="0", ZCoordinate=".001")
Z_2 = UnitZ(Factor=1)
contour = Contour(Shape=sunion, Point=pt_4, Direction=Z_2, Distance=floor_height_mm)  # -> simplify(flatten(Contours))
srf_3 = Surface(contour)
clean = CleanTree(RemoveNulls=True, RemoveInvalid=True, RemoveEmpty=False, Tree=srf_3)
area = Area(Geometry=clean)  # -> Area, Centroid
matrix = ConstructMatrix(Rows="1", Columns="3", Values=remap_3.Mapped)
matrix_2 = ConstructMatrix(Rows="1", Columns="3", Values=remap_4.Mapped)
matrix_3 = ConstructMatrix(Rows="1", Columns="3")
ma = MassAddition(Input=area.Area)  # -> Result, PartialResults
division_3 = Division(A=ma.Result, B="1000000")
number_slider = Slider(39744, range=0..50000)
subtraction = Subtraction(A=division_3, B=target_gfa_in_m2)
group = Group(Objects=sunion)
expression = Expression(x=subtraction, Expression="if(x>0,-99999999,x)")
random = Random(Range=Domain(0, 1000), Number=1, Seed=number_slider)

gfa_m2 = DataRecorder(division_3, DataLimit=-10, RecordData=True)
geometry = DataRecorder(group, DataLimit=-10, RecordData=True)
x_size = DataRecorder(matrix_2, DataLimit=-10, RecordData=True)
z_size = DataRecorder(matrix_3, DataLimit=-10, RecordData=True)
y_size = DataRecorder(matrix, DataLimit=-10, RecordData=True)
fitting_value = DataRecorder(expression, DataLimit=-10, RecordData=True)

galapagos = Galapagos(fitness=num, gene=[genes_3, genes_5, genes, genes_2, number_slider, genes_4])

# ----
# Randomize options first!
num = Number(random)

# ----
# With chosen option in mind
num_2 = Number(expression)

dematrix = DeconstructMatrix(Matrix=x_size)  # -> Rows, Columns, simplify(Values)
dematrix_2 = DeconstructMatrix(Matrix=z_size)  # -> Rows, Columns, simplify(Values)
dematrix_3 = DeconstructMatrix(Matrix=y_size)  # -> Rows, Columns, simplify(Values)
cull_i = CullIndex(List=fitting_value, Indices="0", Wrap=True)
panel = Panel(num_2)
sort = SortList(Keys=cull_i)  # -> simplify(Keys), ValuesA
rev = ReverseList(List=sort.Keys)  # -> flatten(List)
mindex = MemberIndex(Set=cull_i, Member=rev)  # -> simplify(flatten(Index)), Count
simplify = SimplifyTree(Tree=mindex.Index, Front=False)  # -> simplify(graft(Tree))
item = ListItem(List=dematrix.Values, Index=simplify, Wrap=True)
item_2 = ListItem(List=dematrix_2.Values, Index=simplify, Wrap=True)
item_3 = ListItem(List=dematrix_3.Values, Index=simplify, Wrap=True)
trim = TrimTree(Tree=item_3, Depth=1)
trim_2 = TrimTree(Tree=item_2, Depth=1)
trim_3 = TrimTree(Tree=item, Depth=1)
item_4 = ListItem(List=geometry, Index=simplify, Wrap=True)
item_5 = ListItem(List=gfa_m2, Index=simplify, Wrap=True)  # -> simplify(Item)
round = Round(Number=item_5)  # -> Nearest, Floor, Ceiling
branch = TreeBranch(Tree=item_4, Path=seed_selector, MaintainPaths=True)
branch_2 = TreeBranch(Tree=round.Nearest, Path=seed_selector, MaintainPaths=True)
branch_3 = TreeBranch(Tree=trim_3, Path=seed_selector, MaintainPaths=True)
branch_4 = TreeBranch(Tree=trim, Path=seed_selector, MaintainPaths=True)
branch_5 = TreeBranch(Tree=trim_2, Path=seed_selector, MaintainPaths=True)
preview_3 = CustomPreview(
    Geometry=branch,
    Material={diffuse=RGB(221, 160, 221), emission=RGB(66, 48, 66), shine=0.5, specular=RGB(255, 255, 255), transparency=0})
panel_2 = Panel(branch_4)
panel_3 = Panel(branch_5)
panel_4 = Panel(branch_3)

multiplication_2 = Multiplication(A=text_size, B=-1.5)
Y = UnitY(Factor=multiplication_2)
move = Move(Geometry=pt, Motion=Y)  # -> Geometry, Transform
concat = Concatenate(FragmentA="GFA: ", FragmentB=branch_2, FragmentA_2="m2")
concat_2 = Concatenate(FragmentA="seed nr: ", FragmentB=seed_selector)
tag = TextTag3D(Location=pt, Text=concat_2, Size=text_size, Justification=7)
tag_2 = TextTag3D(Location=move.Geometry, Text=concat, Size=text_size, Justification=7)
